# Grasshopper definition Export Geometry with Grasshopper C#.gh (Grasshopper 1.0.7)

geo = Geometry()
path = FilePath()
python = GhPythonScript(geo=geo, type="dwg")  # -> out, filename; inputs geo: list
# ---------- python: Python ----------
import rhinoscriptsyntax as rs

filename = []

for i,e in enumerate(geo):
    filename.append("curve_{0}.{1}".format(i,type))
# ---------- end python ----------
c_script = CSharpScript(geometries=geo, filename=python.filename, directory=path, export=Toggle(False))  # -> out; inputs geometries: list of GeometryBase, filename: list of String, directory: String, export: Boolean
# ---------- c_script: C# usings ----------
using System.IO;
# ---------- c_script: C# ----------
    if(export){

      var guids = new List<Guid>();

      // for(int i = 0; i < geometries.BranchCount; i++){
      // for(int n = 0; n < geometries.Branches[i].Count; n++){
      //  var geom = geometries.Branches[i][n];
      //  var guid = Rhino.RhinoDoc.ActiveDoc.Objects.Add(geom);
      //  guids.Add(guid);
      // }
      //}

      for(int i = 0; i < geometries.Count; i++){

        var geom = geometries[i];
        var guid = Rhino.RhinoDoc.ActiveDoc.Objects.Add(geom);
        guids.Add(guid);
        Rhino.RhinoDoc.ActiveDoc.Objects.Select(guid);
        string filepath = Path.Combine(directory, filename[i]);
        string cmd = "_-Export " + "\"" + filepath + "\"" + " _Enter _Enter";
        Rhino.RhinoApp.RunScript(cmd, false);

        Rhino.RhinoDoc.ActiveDoc.Objects.Delete(guids, true);
      }




    }
# ---------- end c_script ----------
