# Grasshopper definition Peculiar Sliders.gh (Grasshopper 1.0.7)

c_script = CSharpScript(x=Slider(39, range=0..76), y=Slider(76, range=0..100))  # -> out, A; inputs x: Int32, y: Int32
# ---------- c_script: C# ----------
    var input = Component.Params.Input[0].Sources[0]; 
    var slider = input as Grasshopper.Kernel.Special.GH_NumberSlider; 

    if(slider != null) 
    {
      //Color c = Color.FromArgb(255, 255, 0, 0);
      slider.Slider.RailDisplay = Grasshopper.GUI.Base.GH_SliderRailDisplay.Filled;
      slider.Slider.RailFullColour = System.Drawing.Color.FromArgb(y * 2, 255, 0, 0);
      slider.Slider.Minimum = 0;
      slider.Slider.Maximum = y;
    }
# ---------- end c_script ----------
c_script_2 = CSharpScript(x=Slider(5, range=0..25), y=Slider(25, range=0..100))  # -> out, A; inputs x: Int32, y: Int32
# ---------- c_script_2: C# ----------
    var input = Component.Params.Input[0].Sources[0];
    var slider = input as Grasshopper.Kernel.Special.GH_NumberSlider; 

    if(slider != null)
    {
      slider.Slider.Minimum = 0;
      slider.Slider.Maximum = y;
    }
# ---------- end c_script_2 ----------
c_script_3 = CSharpScript(x=Slider(37, range=0..100), y=Slider(37, range=0..100))  # -> out, A; inputs x: Int32, y: Int32
# ---------- c_script_3: C# ----------
    var input = Component.Params.Input[0].Sources[0];
    var slider = input as Grasshopper.Kernel.Special.GH_NumberSlider;

    if(slider != null)
    {
      slider.SetSliderValue((decimal) y);}
# ---------- end c_script_3 ----------
