# Grasshopper definition C# Pinched Grid.gh (Grasshopper 1.0.7)

number_slider = Slider(42, range=0..100)
number_slider_2 = Slider(123.322, range=0..1000)
# aashkann.com
# aashkann@outlook.com
P = Plane(Plane(origin=(-1193.300861, 20057.36683, 0), x=(0, 1, 0), y=(-1, 0, 0)))
recgrid = Rectangular(Plane=P, SizeX=number_slider_2, SizeY=number_slider_2, ExtentX=number_slider, ExtentY=number_slider)  # -> Cells, Points
bbox = BoundingBox(Content=flatten(recgrid.Points), Plane=PlaneXY(0, 0, 0), UnionBox=True)  # -> Box, Box_2
pop2d = Populate2D(Region=bbox.Box, Count=Slider(7, range=0..10), Seed=Slider(7, range=0..10))
number_slider_3 = Slider(861.96, range=0..3000)
pt = Point(recgrid.Points)
pt_2 = Point(pop2d)
cir = Circle(Plane=pt_2, Radius=number_slider_3)
pinch_grid = CSharpScript(gPoints=pt, pPoints=pt_2, range=number_slider_3)  # -> out, A; inputs gPoints: tree of Point3d, pPoints: list of Point3d, range: Double
# ---------- pinch_grid: C# ----------
    int branchNum = gPoints.BranchCount;
    int memberNum = gPoints.DataCount;
    int collectionNum = memberNum / branchNum;
    A = collectionNum;


    for(int j = 0; j < branchNum ;j++){
      for(int b = 0 ; b < collectionNum ; b++){
        List<double> dist = new List<double>();
        List<double> sortDist = new List<double>();
        Point3d gridPoint = new Point3d(gPoints.Branch(j)[b]);

        //Calculating distances to find a closest points
        for(int i = 0 ; i < pPoints.Count ; i++){
          sortDist.Add(gridPoint.DistanceTo(pPoints[i]));
          dist.Add(gridPoint.DistanceTo(pPoints[i]));
        }

        //Sorting the list and define the min value
        sortDist.Sort();
        double minValue = sortDist[0];
        A = sortDist;
        int minIndex;
        Point3d ptToCompare = new Point3d();

        //Finding the point and  Its index number
        for(int m = 0; m < dist.Count;  m++){
          if(dist[m] == minValue){
            ptToCompare = pPoints[m];
            minIndex = m;
          }
        }
        //Calculating distances to the closest points
        double closDist = gridPoint.DistanceTo(ptToCompare);
        if(closDist < range){
          gPoints.Branch(j).RemoveAt(b);
          gPoints.Branch(j).Insert(b, ptToCompare);
        }




      }

    }




    A = gPoints;
    //The End of Runtime
# ---------- end pinch_grid ----------
pt_3 = Point(pinch_grid.A)
points = PointList(Points=cir, Size=Slider(100, range=0..100))
flip = FlipMatrix(Data=pt_3)  # -> simplify(Data)
merge = Merge(Data1=pt_3, Data2=flip)
pline = PolyLine(Vertices=merge, Closed=False)
divide = DivideCurve(Curve=pline, Count=Slider(7, range=0..100), Kinks=False)  # -> Points, Tangents, Parameters
intcrv = Interpolate(Vertices=divide.Points, Degree=3, Periodic=False, KnotStyle=1)  # -> Curve, Length, Domain
